# Grasshopper definition grasshopper.gh (Grasshopper 1.0.7)
# plug-ins: Kangaroo2 Components

coords = ImportCoordinates(
    File="C:\Users\Zhujingxi\Desktop\Project\Hard To Define\Audio to ring\grasshopper v0.4 shape\Porn.txt",
    Separator=",",
    XIndex=0,
    YIndex=1,
    ZIndex=2)
pdecon = Deconstruct(Point=coords)  # -> XComponent, YComponent, ZComponent
multiplication = Multiplication(A=Slider(1.499, range=1..2), B=pdecon.XComponent)
pt = ConstructPoint(XCoordinate=multiplication, YCoordinate=pdecon.YComponent, ZCoordinate=pdecon.ZComponent)  # -> flatten(Point)
con = DelaunayEdges(Points=pt, Plane=PlaneXY(0, 0, 0))  # -> Connectivity, Edges
mp = MultiPipe(
    Curves=con.Edges,
    NodeSize=Slider(5, range=0..5),
    EndOffset="0",
    StrutSize=Slider(3.694, range=0..4),
    Segment=0,
    KinkAngle=Slider(0.634, range=0..1),
    CubeFit="1",
    Caps="1")
scale = Scale(Geometry=mp, Center=Point(0, 0, 0), Factor=Slider(0.065, range=0..0.5))  # -> Geometry, Transform
preview = CustomPreview(
    Geometry=scale.Geometry,
    Material={diffuse=RGB(0, 0, 0), emission=RGB(0, 0, 0), shine=0.2, specular=RGB(35, 36, 35), transparency=0})
