# Grasshopper definition ring.gh (Grasshopper 1.0.7)
# plug-ins: Kangaroo2 Components, Topologizer

coords = ImportCoordinates(
    File="C:\Users\Zhujingxi\Desktop\Project\Hard To Define\Audio to ring\grasshopper v0.5\Zhujingxi.txt",
    Separator=",",
    XIndex=0,
    YIndex=1,
    ZIndex=2)

pdecon = Deconstruct(Point=coords)  # -> XComponent, YComponent, ZComponent
multiplication = Multiplication(A=Slider(0.027, range=0..0.1), B=pdecon.XComponent)
multiplication_2 = Multiplication(A=Slider(0.176, range=0..0.5), B=pdecon.YComponent)
multiplication_3 = Multiplication(A=Slider(0.047, range=0..0.1), B=pdecon.ZComponent)
pt = ConstructPoint(XCoordinate=multiplication, YCoordinate=multiplication_2, ZCoordinate=multiplication_3)  # -> flatten(Point)

addition = Addition(A="8", B="1")
pt_2 = ConstructPoint(XCoordinate="8", YCoordinate="0", ZCoordinate="8")
item = ListItem(List=multiplication_2, Index="-1", Wrap=True)
pt_3 = ConstructPoint(XCoordinate="8", YCoordinate=item, ZCoordinate="8")
ln = Line(StartPoint=pt_2, EndPoint=pt_3)
len = Length(Curve=ln)
pi = Pi(Factor=1)
multiplication_4 = Multiplication(A=addition, B="-1")
division = Division(A=len, B=pi)
addition_2 = Addition(A="8", B="0.5")
xy = XYPlane(Origin=Point(0, 0, 0))
cir = Circle(Plane=xy, Radius=division)
subtraction = Subtraction(A=division, B=addition_2)
addition_3 = Addition(A=division, B=addition_2)
pt_4 = ConstructPoint(XCoordinate="0", YCoordinate="0", ZCoordinate=addition)
pt_5 = ConstructPoint(XCoordinate="0", YCoordinate="0", ZCoordinate=multiplication_4)
ln_2 = Line(StartPoint=pt_4, EndPoint=pt_5)
vec = VectorXYZ(XComponent=0, YComponent=0, ZComponent=addition)  # -> Vector, Length
flow = Flow(Geometry=pt, Base=ln, Target=cir, ReverseBase=False, ReverseTarget=False, Stretch=True, Rigid=False)
move = Move(Geometry=xy, Motion=vec.Vector)  # -> Geometry, Transform
addition_4 = Addition(A=subtraction, B="0.05")
con = DelaunayEdges(Points=flow, Plane=PlaneXY(0, 0, 0))  # -> Connectivity, Edges
cir_2 = Circle(Plane=move.Geometry, Radius=subtraction)
panel = Panel(con.Edges)
cir_3 = Circle(Plane=move.Geometry, Radius=addition_3)
cir_4 = Circle(Plane=move.Geometry, Radius=addition_4)
extr = Extrude(Base=cir_2, Direction=ln_2)
extr_2 = Extrude(Base=cir_3, Direction=ln_2)
extr_3 = Extrude(Base=cir_4, Direction=ln_2)
cap = CapHoles(Brep=extr)
cap_2 = CapHoles(Brep=extr_2)
cap_3 = CapHoles(Brep=extr_3)
trim = TrimWithBrep(Curve=con.Edges, Brep=cap)  # -> Inside, Outside
sdiff = SolidDifference(BrepsA=cap_2, BrepsB=cap_3)
crv = Curve(trim.Outside)

toggle = BooleanToggle(True)
end = EndPoints(Curve=crv)  # -> Start, End
brepinc = PointInBrep(Brep=sdiff, Point=end.Start, Strict=toggle)
brepinc_2 = PointInBrep(Brep=sdiff, Point=end.End, Strict=toggle)
and = GateAnd(A=brepinc, B=brepinc_2)
dispatch = Dispatch(List=crv, DispatchPattern=and)  # -> ListA, ListB
crv_2 = Curve(flatten(dispatch.ListA))

vec_2 = VectorXYZ(XComponent=0, YComponent=0, ZComponent=Slider(10, range=0..10))  # -> Vector, Length
move_2 = Move(Geometry=crv_2, Motion=vec_2.Vector)  # -> Geometry, Transform

crv_3 = Curve(move_2.Geometry)
end_2 = EndPoints(Curve=crv_3)  # -> Start, End
cullpt = CullDuplicates(Points=flatten([end_2.Start, end_2.End]), Tolerance=0.1, CullMode=3)  # -> Points, Indices, Valence
crv_cp = CurveClosestPoint(Point=graft(cullpt.Points), Curve=crv_3)  # -> Point, Parameter, Distance
num = Number(expr("round(x, 5)", crv_cp.Parameter))
smaller = SmallerThan(FirstNumber=crv_cp.Distance, SecondNumber=Slider(1, range=0..1))  # -> SmallerThan, OrEqualTo
equals = Equality(FirstNumber=num, SecondNumber=0)  # -> Equality, Inequality
equals_2 = Equality(FirstNumber=num, SecondNumber=1)  # -> Equality, Inequality
long = LongestList(ListA=crv_3, ListB=crv_cp.Point, PaddingMode=2)  # -> ListA, ListB
and_2 = GateAnd(A=equals.Inequality, B=equals_2.Inequality, C=smaller.SmallerThan)
flip = FlipMatrix(Data=and_2)
cull = CullPattern(List=crv_cp.Parameter, CullPattern=and_2)
cull_2 = CullPattern(List=long.ListA, CullPattern=and_2)
ma = MassAddition(Input=flip)  # -> Result, PartialResults
cull_3 = CullPattern(List=graft(crv_3), CullPattern=invert(ma.Result))
shatter = Shatter(Curve=cull_2, Parameters=cull)
crv_4 = Curve(cull_3)
merge = Merge(Data1=crv_4, Data2=shatter)  # -> flatten(Result)
topo = Topologizer(LinesInput=merge, FixPoints=cullpt.Points, Tolerance=Slider(1, range=0..2))  # -> L, P, S, E, N, I, O, G
toggle_2 = BooleanToggle(True)
mp = MultiPipe(
    Curves=topo.L,
    NodeSize=Slider(0.822, range=0..1),
    EndOffset=1,
    StrutSize=Slider(0.824, range=0..1),
    Segment=1,
    KinkAngle=0.6,
    CubeFit=toggle_2,
    Caps=toggle_2)

preview = CustomPreview(Geometry=mp, Material=ColourSwatch(SwatchColor=RGB(115, 115, 115)))
