# Grasshopper definition ring.ghx (Grasshopper 1.0.7)
# plug-ins: Kangaroo2 Components

# ---- group: RH_IN:CorX
txt = Text()

# ---- group: RH_IN:CorY
txt_2 = Text()

# ---- group: RH_IN:CorZ
txt_3 = Text()

# ----
pt = ConstructPoint(XCoordinate=txt, YCoordinate=txt_2, ZCoordinate=txt_3)
ring_size = Slider(63.5, range=0..100)
vec = VectorXYZ(XComponent=Slider(0, range=0..20), YComponent=Slider(0, range=0..20), ZComponent=Slider(8, range=0..20))  # -> Vector, Length

coords = ImportCoordinates(Separator=",", XIndex=0, YIndex=1, ZIndex=2)  # disabled
panel = Panel("128")
pi = Pi(Factor=1)
xy = XYPlane(Origin=Point(0, 0, 0))

pdecon = Deconstruct(Point=pt)  # -> XComponent, YComponent, ZComponent

# ---- group: RH_IN:Inner
num = Number(Slider(0.026, range=0..0.2))

# ----
multiplication = Multiplication(A=num, B="128")

# ---- group: RH_IN:Outer
num_2 = Number(Slider(0.101, range=0..0.2))

# ---- group: RH_IN:Height
num_3 = Number(Slider(0.068, range=0..0.1))

# ----
multiplication_2 = Multiplication(A=num_3, B="128")

multiplication_3 = Multiplication(A=num, B=pdecon.XComponent)
multiplication_4 = Multiplication(A=num_2, B=pdecon.YComponent)
multiplication_5 = Multiplication(A=num_3, B=pdecon.ZComponent)
pt_2 = ConstructPoint(XCoordinate=multiplication_3, YCoordinate=multiplication_4, ZCoordinate=multiplication_5)  # -> flatten(Point)

addition = Addition(A=multiplication_2, B="1")
pt_3 = ConstructPoint(XCoordinate=multiplication, YCoordinate="0", ZCoordinate=multiplication_2)
item = ListItem(List=multiplication_4, Index="-1", Wrap=True)
pt_4 = ConstructPoint(XCoordinate=multiplication, YCoordinate=item, ZCoordinate=multiplication_2)
ln = Line(StartPoint=pt_3, EndPoint=pt_4)
len = Length(Curve=ln)
multiplication_6 = Multiplication(A=addition, B="-1")
division = Division(A=len, B=pi)
addition_2 = Addition(A=multiplication_2, B="2")
cir = Circle(Plane=xy, Radius=division)
pt_5 = ConstructPoint(XCoordinate="0", YCoordinate="0", ZCoordinate=addition)
pt_6 = ConstructPoint(XCoordinate="0", YCoordinate="0", ZCoordinate=multiplication_6)
addition_3 = Addition(A=division, B=addition_2)
subtraction = Subtraction(A=division, B=addition_2)
vec_2 = VectorXYZ(XComponent=0, YComponent=0, ZComponent=addition)  # -> Vector, Length
flow = Flow(Geometry=pt_2, Base=ln, Target=cir, ReverseBase=False, ReverseTarget=False, Stretch=True, Rigid=False)
addition_4 = Addition(A=subtraction, B="0.05")
move = Move(Geometry=xy, Motion=vec_2.Vector)  # -> Geometry, Transform
con = DelaunayEdges(Points=flow, Plane=PlaneXY(0, 0, 0))  # -> Connectivity, Edges
ln_2 = Line(StartPoint=pt_5, EndPoint=pt_6)
cir_2 = Circle(Plane=move.Geometry, Radius=subtraction)
panel_2 = Panel(con.Edges)
extr = Extrude(Base=cir_2, Direction=ln_2)
cir_3 = Circle(Plane=move.Geometry, Radius=addition_3)
cir_4 = Circle(Plane=move.Geometry, Radius=addition_4)
cap = CapHoles(Brep=extr)
extr_2 = Extrude(Base=cir_3, Direction=ln_2)
extr_3 = Extrude(Base=cir_4, Direction=ln_2)
cap_2 = CapHoles(Brep=extr_2)
cap_3 = CapHoles(Brep=extr_3)
sdiff = SolidDifference(BrepsA=cap_2, BrepsB=cap_3)

trim = TrimWithBrep(Curve=con.Edges, Brep=cap)  # -> Inside, Outside
crv = Curve(trim.Outside)
toggle = BooleanToggle(True)
end = EndPoints(Curve=crv)  # -> Start, End
brepinc = PointInBrep(Brep=sdiff, Point=end.End, Strict=toggle)
brepinc_2 = PointInBrep(Brep=sdiff, Point=end.Start, Strict=toggle)
and = GateAnd(A=brepinc_2, B=brepinc)
dispatch = Dispatch(List=crv, DispatchPattern=and)  # -> ListA, ListB
crv_2 = Curve(flatten(dispatch.ListA))

len_2 = Length(Curve=cir_2)
division_2 = Division(A=ring_size, B=len_2)

crv_3 = Curve(crv_2)

# ---- group: RH_IN:NodeSize
num_4 = Number(Slider(0.508, range=0..1))

# ---- group: RH_IN:StrutSize
num_5 = Number(Slider(5.196, range=0..10))

# ---- group: RH_IN:KinkAngle
num_6 = Number(Slider(0.717, range=0..1))

# ----
mp = MultiPipe(Curves=crv_3, NodeSize=num_4, EndOffset="0", StrutSize=num_5, Segment=0, KinkAngle=num_6, CubeFit="1", Caps="1")
scale = Scale(Geometry=mp, Center=Point(0, 0, 0), Factor=division_2)  # -> Geometry, Transform

preview = CustomPreview(Geometry=mp, Material={diffuse=RGB(0, 0, 0), emission=RGB(0, 0, 0), shine=0.2, specular=RGB(35, 36, 35), transparency=0})
move_2 = Move(Geometry=scale.Geometry, Motion=vec.Vector)  # -> Geometry, Transform

# ---- group: RH_OUT:Geo
brep = Brep(move_2.Geometry)

# ----
preview_2 = CustomPreview(
    Geometry=move_2.Geometry,
    Material={diffuse=RGB(0, 0, 0), emission=RGB(0, 0, 0), shine=0.2, specular=RGB(35, 36, 35), transparency=0})
